# Dynamo graph Tokenisation_WorkshopFile.dyn "TheoDavideWorkshopFile" (Dynamo 2.8.0.2471)
# packages: Topologic 1.4.0.1

code_block = CodeBlock { 10; }
byLengths = Cuboid.ByLengths(width=code_block, length=code_block, height=code_block)
code_block_2 = CodeBlock { 0..20..10; }
translate = Geometry.Translate(geometry=byLengths, xTranslation=code_block_2, yTranslation=code_block_2, lacing=CrossProduct)
flatten = List.Flatten(list=translate)
byGeometry = Topologic.Topology.ByGeometry(geometry=flatten)
byCells = Topologic.CellComplex.ByCells(cells=byGeometry)
centroid = Topologic.Topology.Centroid(topology=byGeometry)
count = List.Count(list=centroid)
code_block_3 = CodeBlock(count=count) { "tokenID"; 0..(count-1); }
byKeysValues = DesignScript.Builtin.Dictionary.ByKeysValues(keys=code_block_3.out0, values=code_block_3.out1, lacing=Longest)
type = Topologic.Cell.Type()
setDictionaries = Topologic.Topology.SetDictionaries(topology=byCells, selectors=centroid, dictionaries=byKeysValues, typeFilter=type)
edges = Topologic.Topology.Edges(topology=setDictionaries)
centroid_2 = Topologic.Topology.Centroid(topology=edges)
count_2 = List.Count(list=edges)
code_block_4 = CodeBlock(count=count_2) { "tokenID"; 20..(count+19); }
code_block_5 = CodeBlock { 10; }
mul = code_block_4.out1 * code_block_5
byKeysValues_2 = DesignScript.Builtin.Dictionary.ByKeysValues(keys=code_block_4.out0, values=mul, lacing=Longest)
type_2 = Topologic.Edge.Type()
setDictionaries_2 = Topologic.Topology.SetDictionaries(topology=setDictionaries, selectors=centroid_2, dictionaries=byKeysValues_2, typeFilter=type_2)
cells = Topologic.Topology.Cells(topology=setDictionaries_2)
dictionary = Topologic.Topology.Dictionary(topology=cells)
edges_2 = Topologic.Topology.Edges(topology=setDictionaries_2)
dictionary_2 = Topologic.Topology.Dictionary(topology=edges_2)
code_block_6 = CodeBlock { "tokenID"; }
valueAtKey = DesignScript.Builtin.Dictionary.ValueAtKey(dictionary=dictionary_2, key=code_block_6)
code_block_7 = CodeBlock { 330; }
eq = valueAtKey == code_block_7
filterByBoolMask = List.FilterByBoolMask(list=edges_2, mask=eq)
watch = Watch(filterByBoolMask.in)
geometry = Topologic.Topology.Geometry(topology=filterByBoolMask.in)
code_block_8 = CodeBlock { -0.5; }
translate_2 = Geometry.Translate(geometry=geometry, xTranslation=code_block_8, yTranslation=code_block_8, zTranslation=code_block_8)
code_block_9 = CodeBlock(c=cells) { c[0]; }
edges_3 = Topologic.Topology.Edges(topology=code_block_9)
dictionary_3 = Topologic.Topology.Dictionary(topology=edges_3)
code_block_10 = CodeBlock { "tokenID"; }
valueAtKey_2 = DesignScript.Builtin.Dictionary.ValueAtKey(dictionary=dictionary_3, key=code_block_10)
eq_2 = valueAtKey_2 == code_block_7
filterByBoolMask_2 = List.FilterByBoolMask(list=edges_3, mask=eq_2)
watch_2 = Watch(filterByBoolMask_2.in)
geometry_2 = Topologic.Topology.Geometry(topology=filterByBoolMask_2.in)
