# Dynamo graph web3test-ForTheo.dyn (Dynamo 2.8.0.2471)

code_block = CodeBlock()
# ---------- code_block.designscript (7 lines) ----------
contract_addres = "0xb80206789De27D14b3f458Bed9072d4a0129b41e";
wallet_private_key = "XXXXXXXXXXXXXXXXX";
wallet_address = "XXXXXXXXXXXXXXXXX";
infura_url = "https://ropsten.infura.io/XXXXXXXXXXXXX";
path = "C:\\Users\\XXXXX\\anaconda3\\envs\\dynamo383\\lib\\site-packages";
message = "Type Your Message Here";
number = 98765;
# ----------------------------------------
python_script = Python(IN[0]=code_block.contract_addres, IN[1]=code_block.wallet_private_key, IN[2]=code_block.wallet_address, IN[3]=code_block.infura_url, IN[4]=code_block.path, IN[5]=code_block.message, IN[6]=code_block.number)  # CPython3
# ---------- python_script.python (67 lines) ----------
# INPUTS
contract_address = IN[0]
wallet_private_key = IN[1]
wallet_address = IN[2]
infura_url = IN[3]
path = IN[4]
message = IN[5]
number = IN[6]
import time
import sys
sys.path.append(path)
from web3 import Web3, HTTPProvider

w3 = Web3(HTTPProvider(infura_url))


contract_abi = "[{\"anonymous\":false,\"inputs\":[{\"indexed\":true,\"internalType\":\"address\",\"name\":\"previousOwner\",\"type\":\"address\"},{\"indexed\":true,\"internalType\":\"address\",\"name\":\"newOwner\",\"type\":\"address\"}],\"name\":\"OwnershipTransferred\",\"type\":\"event\"},{\"inputs\":[],\"name\":\"renounceOwnership\",\"outputs\":[],\"stateMutability\":\"nonpayable\",\"type\":\"function\"},{\"inputs\":[{\"internalType\":\"string\",\"name\":\"_IPFSHash\",\"type\":\"string\"}],\"name\":\"setIPFSHash\",\"outputs\":[],\"stateMutability\":\"payable\",\"type\":\"function\"},{\"inputs\":[{\"internalType\":\"uint256\",\"name\":\"_myUint\",\"type\":\"uint256\"}],\"name\":\"setMyUint\",\"outputs\":[],\"stateMutability\":\"payable\",\"type\":\"function\"},{\"inputs\":[{\"internalType\":\"address\",\"name\":\"newOwner\",\"type\":\"address\"}],\"name\":\"transferOwnership\",\"outputs\":[],\"stateMutability\":\"nonpayable\",\"type\":\"function\"},{\"inputs\":[],\"name\":\"IPFSHash\",\"outputs\":[{\"internalType\":\"string\",\"name\":\"\",\"type\":\"string\"}],\"stateMutability\":\"view\",\"type\":\"function\"},{\"inputs\":[],\"name\":\"myUint\",\"outputs\":[{\"internalType\":\"uint256\",\"name\":\"\",\"type\":\"uint256\"}],\"stateMutability\":\"view\",\"type\":\"function\"},{\"inputs\":[],\"name\":\"owner\",\"outputs\":[{\"internalType\":\"address\",\"name\":\"\",\"type\":\"address\"}],\"stateMutability\":\"view\",\"type\":\"function\"}]"


smartContract = w3.eth.contract(address=contract_address, abi=contract_abi)



receipts = []
nonce = w3.eth.getTransactionCount(wallet_address)
tx_dict = smartContract.functions.setIPFSHash(message).buildTransaction({
    'chainId' : 3,
    'gas' : 210000,
    'gasPrice' : w3.toWei('50', 'gwei'),
    'nonce' : nonce,
})

signed_tx = w3.eth.account.sign_transaction(tx_dict, wallet_private_key)
tx_hash = w3.eth.sendRawTransaction(signed_tx.rawTransaction)
tx_receipt = w3.eth.waitForTransactionReceipt(tx_hash, timeout=120, poll_latency=0.1)
receipts.append(tx_receipt)

nonce = w3.eth.getTransactionCount(wallet_address)
tx_dict = smartContract.functions.setMyUint(number).buildTransaction({
    'chainId' : 3,
    'gas' : 210000,
    'gasPrice' : w3.toWei('50', 'gwei'),
    'nonce' : nonce,
})
signed_tx = w3.eth.account.sign_transaction(tx_dict, wallet_private_key)
tx_hash = w3.eth.sendRawTransaction(signed_tx.rawTransaction)
tx_receipt = w3.eth.waitForTransactionReceipt(tx_hash, timeout=120, poll_latency=0.1)

receipts.append(tx_receipt)



outputList = []
for tx_receipt in receipts:
    receipt = []
    receipt.append('blockHash: '+str(tx_receipt['blockHash']))
    receipt.append('blockNumber: '+str(tx_receipt['blockNumber']))
    receipt.append('contractAddress: '+str(tx_receipt['contractAddress']))
    receipt.append('cumulativeGasUsed: '+str(tx_receipt['cumulativeGasUsed']))
    receipt.append('from: '+str(tx_receipt['from']))
    receipt.append('gasUsed: '+str(tx_receipt['gasUsed']))
    receipt.append('logs: '+str(tx_receipt['logs']))
    receipt.append('to: '+str(tx_receipt['to']))
    receipt.append('transactionHash: '+str(tx_receipt['transactionHash']))
    receipt.append('tansactionIndex: '+str(tx_receipt['transactionIndex']))
    outputList.append(receipt)
OUT = outputList
# ----------------------------------------
watch = Watch(python_script)
