# Dynamo graph non_manifold_topology_token_a.dyn (Dynamo 2.8.0.2471)
# packages: Topologic 1.0.0

code_block = CodeBlock { 10; }
byLengths = Cuboid.ByLengths(width=code_block, length=code_block, height=code_block)
code_block_2 = CodeBlock { 0..20..10; }
translate = Geometry.Translate(geometry=byLengths, xTranslation=code_block_2, yTranslation=code_block_2, lacing=CrossProduct)
flatten = List.Flatten(list=translate)
byGeometry = Topologic.Topology.ByGeometry(geometry=flatten)
byCells = Topologic.CellComplex.ByCells(cells=byGeometry)
centroid = Topologic.Topology.Centroid(topology=byGeometry)
count = List.Count(list=centroid)
code_block_3 = CodeBlock(count=count) { "tokenID"; 0..(count-1); }
byKeysValues = DesignScript.Builtin.Dictionary.ByKeysValues(keys=code_block_3.out0, values=code_block_3.out1, lacing=Longest)
type = Topologic.Cell.Type()
setDictionaries = Topologic.Topology.SetDictionaries(topology=byCells, selectors=centroid, dictionaries=byKeysValues, typeFilter=type)
edges = Topologic.Topology.Edges(topology=setDictionaries)
centroid_2 = Topologic.Topology.Centroid(topology=edges)
count_2 = List.Count(list=edges)
code_block_4 = CodeBlock(count=count_2) { "tokenID"; 20..(count+19); }
code_block_5 = CodeBlock { 10; }
mul = code_block_4.out1 * code_block_5
byKeysValues_2 = DesignScript.Builtin.Dictionary.ByKeysValues(keys=code_block_4.out0, values=mul, lacing=Longest)
type_2 = Topologic.Edge.Type()
setDictionaries_2 = Topologic.Topology.SetDictionaries(topology=setDictionaries, selectors=centroid_2, dictionaries=byKeysValues_2, typeFilter=type_2)
cells = Topologic.Topology.Cells(topology=setDictionaries_2)
dictionary = Topologic.Topology.Dictionary(topology=cells)
edges_2 = Topologic.Topology.Edges(topology=setDictionaries_2)
dictionary_2 = Topologic.Topology.Dictionary(topology=edges_2)
code_block_6 = CodeBlock { "tokenID"; }
valueAtKey = DesignScript.Builtin.Dictionary.ValueAtKey(dictionary=dictionary_2, key=code_block_6)
code_block_7 = CodeBlock { 330; }
eq = valueAtKey == code_block_7
filterByBoolMask = List.FilterByBoolMask(list=edges_2, mask=eq)
watch = Watch(filterByBoolMask.in)
geometry = Topologic.Topology.Geometry(topology=cells)
code_block_8 = CodeBlock { -0.5; }
translate_2 = Geometry.Translate(geometry=geometry, xTranslation=code_block_8, yTranslation=code_block_8, zTranslation=code_block_8)
code_block_9 = CodeBlock(c=cells) { c[0]; }
edges_3 = Topologic.Topology.Edges(topology=code_block_9)
dictionary_3 = Topologic.Topology.Dictionary(topology=edges_3)
code_block_10 = CodeBlock { "tokenID"; }
valueAtKey_2 = DesignScript.Builtin.Dictionary.ValueAtKey(dictionary=dictionary_3, key=code_block_10)
eq_2 = valueAtKey_2 == code_block_7
filterByBoolMask_2 = List.FilterByBoolMask(list=edges_3, mask=eq_2)
watch_2 = Watch(filterByBoolMask_2.in)
geometry_2 = Topologic.Topology.Geometry(topology=filterByBoolMask_2.in)
watch_3 = Watch(geometry)
byCells_2 = Topologic.CellComplex.ByCells(cells=cells)
geometry_3 = Topologic.Topology.Geometry(topology=filterByBoolMask.in)
translate_3 = Geometry.Translate(geometry=geometry_3, xTranslation=code_block_8, yTranslation=code_block_8, zTranslation=code_block_8)
code_block_11 = CodeBlock()
# ---------- code_block_11.designscript (7 lines) ----------
contract_addres = "0xb80206789De27D14b3f458Bed9072d4a0129b41e";
wallet_private_key = "XXXXXXXXXXXXXXXXX";
wallet_address = "XXXXXXXXXXXXXXXXX";
infura_url = "https://ropsten.infura.io/XXXXXXXXXXXXX";
path = "C:\\Users\\XXXXX\\anaconda3\\envs\\dynamo383\\lib\\site-packages";
message = "Type Your Message Here";
number = 98765;
# ----------------------------------------
python_script = Python(IN[0]=code_block_11.contract_addres, IN[1]=code_block_11.wallet_private_key, IN[2]=code_block_11.wallet_address, IN[3]=code_block_11.infura_url, IN[4]=code_block_11.path, IN[5]=code_block_11.message, IN[6]=code_block_11.number)  # CPython3
# ---------- python_script.python (67 lines) ----------
# INPUTS
contract_address = IN[0]
wallet_private_key = IN[1]
wallet_address = IN[2]
infura_url = IN[3]
path = IN[4]
message = IN[5]
number = IN[6]
import time
import sys
sys.path.append(path)
from web3 import Web3, HTTPProvider

w3 = Web3(HTTPProvider(infura_url))


contract_abi = "[{\"anonymous\":false,\"inputs\":[{\"indexed\":true,\"internalType\":\"address\",\"name\":\"previousOwner\",\"type\":\"address\"},{\"indexed\":true,\"internalType\":\"address\",\"name\":\"newOwner\",\"type\":\"address\"}],\"name\":\"OwnershipTransferred\",\"type\":\"event\"},{\"inputs\":[],\"name\":\"renounceOwnership\",\"outputs\":[],\"stateMutability\":\"nonpayable\",\"type\":\"function\"},{\"inputs\":[{\"internalType\":\"string\",\"name\":\"_IPFSHash\",\"type\":\"string\"}],\"name\":\"setIPFSHash\",\"outputs\":[],\"stateMutability\":\"payable\",\"type\":\"function\"},{\"inputs\":[{\"internalType\":\"uint256\",\"name\":\"_myUint\",\"type\":\"uint256\"}],\"name\":\"setMyUint\",\"outputs\":[],\"stateMutability\":\"payable\",\"type\":\"function\"},{\"inputs\":[{\"internalType\":\"address\",\"name\":\"newOwner\",\"type\":\"address\"}],\"name\":\"transferOwnership\",\"outputs\":[],\"stateMutability\":\"nonpayable\",\"type\":\"function\"},{\"inputs\":[],\"name\":\"IPFSHash\",\"outputs\":[{\"internalType\":\"string\",\"name\":\"\",\"type\":\"string\"}],\"stateMutability\":\"view\",\"type\":\"function\"},{\"inputs\":[],\"name\":\"myUint\",\"outputs\":[{\"internalType\":\"uint256\",\"name\":\"\",\"type\":\"uint256\"}],\"stateMutability\":\"view\",\"type\":\"function\"},{\"inputs\":[],\"name\":\"owner\",\"outputs\":[{\"internalType\":\"address\",\"name\":\"\",\"type\":\"address\"}],\"stateMutability\":\"view\",\"type\":\"function\"}]"


smartContract = w3.eth.contract(address=contract_address, abi=contract_abi)



receipts = []
nonce = w3.eth.getTransactionCount(wallet_address)
tx_dict = smartContract.functions.setIPFSHash(message).buildTransaction({
    'chainId' : 3,
    'gas' : 210000,
    'gasPrice' : w3.toWei('50', 'gwei'),
    'nonce' : nonce,
})

signed_tx = w3.eth.account.sign_transaction(tx_dict, wallet_private_key)
tx_hash = w3.eth.sendRawTransaction(signed_tx.rawTransaction)
tx_receipt = w3.eth.waitForTransactionReceipt(tx_hash, timeout=120, poll_latency=0.1)
receipts.append(tx_receipt)

nonce = w3.eth.getTransactionCount(wallet_address)
tx_dict = smartContract.functions.setMyUint(number).buildTransaction({
    'chainId' : 3,
    'gas' : 210000,
    'gasPrice' : w3.toWei('50', 'gwei'),
    'nonce' : nonce,
})
signed_tx = w3.eth.account.sign_transaction(tx_dict, wallet_private_key)
tx_hash = w3.eth.sendRawTransaction(signed_tx.rawTransaction)
tx_receipt = w3.eth.waitForTransactionReceipt(tx_hash, timeout=120, poll_latency=0.1)

receipts.append(tx_receipt)



outputList = []
for tx_receipt in receipts:
    receipt = []
    receipt.append('blockHash: '+str(tx_receipt['blockHash']))
    receipt.append('blockNumber: '+str(tx_receipt['blockNumber']))
    receipt.append('contractAddress: '+str(tx_receipt['contractAddress']))
    receipt.append('cumulativeGasUsed: '+str(tx_receipt['cumulativeGasUsed']))
    receipt.append('from: '+str(tx_receipt['from']))
    receipt.append('gasUsed: '+str(tx_receipt['gasUsed']))
    receipt.append('logs: '+str(tx_receipt['logs']))
    receipt.append('to: '+str(tx_receipt['to']))
    receipt.append('transactionHash: '+str(tx_receipt['transactionHash']))
    receipt.append('tansactionIndex: '+str(tx_receipt['transactionIndex']))
    outputList.append(receipt)
OUT = outputList
# ----------------------------------------
watch_4 = Watch(python_script)
code_block_12 = CodeBlock()
# ---------- code_block_12.designscript (7 lines) ----------
contract_addres = "0xb80206789De27D14b3f458Bed9072d4a0129b41e";
wallet_private_key = "PATH_TO_PRIVAT_KEY_FILE";
wallet_address = "XXXXXXXXXXXXXXXXX";
infura_url = "https://ropsten.infura.io/XXXXXXXXXXXXX";
path = "C:\\Users\\XXXXX\\anaconda3\\envs\\dynamo383\\lib\\site-packages";
IPFSString = "Type Your IPFS String Here";
number = 98765;
# ----------------------------------------
python_script_2 = Python(IN[0]=code_block_12.contract_addres, IN[1]=code_block_12.wallet_private_key, IN[2]=code_block_12.wallet_address, IN[3]=code_block_12.infura_url, IN[4]=code_block_12.path, IN[5]=code_block_12.IPFSString, IN[6]=code_block_12.number)  # CPython3; same code as python_script
watch_5 = Watch(python_script_2)
